# Grasshopper definition test.gh (Grasshopper 1.0.8)
# plug-ins: eleFront Rhino 6 Legacy

xy = XYPlane(Origin=Point(0, 0, 0))
cir = Circle(Plane=xy, Radius=Slider(0.25, range=0..1))
circle = EFDataDescriptionR6(cir)
panel = Panel(cir)
Z = UnitZ(Factor=1)
attributes_r6 = DefineObjectAttributesR6(UserKeys="circle", UserValues="circle")
Z_2 = UnitZ(Factor=1)
extr = Extrude(Base=circle, Direction=Z_2)
panel_2 = Panel(extr)
attributes_r6_2 = DefineObjectAttributesR6(UserKeys="circle", UserValues="circle")
bake_r6 = BakeObjectsR6(Geometry=extr, Attributes=attributes_r6_2, BakeName="circle", Bake=False)
xy_2 = XYPlane(Origin=Point(0, 0, 0))
cir_2 = Circle(Plane=xy_2, Radius=Slider(0.25, range=0..1))
circle_2 = EFDataDescriptionR6(cir_2)
panel_3 = Panel(cir_2)
extr_2 = Extrude(Base=circle_2, Direction=Z)
panel_4 = Panel(extr_2)
bake_r6_2 = BakeObjectsR6(Geometry=extr_2, Attributes=attributes_r6, BakeName="circle", Bake=False)
